# Grasshopper definition load_robot_base.gh (Grasshopper 1.0.7)

path = Panel("C:\Users\77777777\source\repos\digital_future\data_locate_base\")

# ---- group: wood
load_robot_base = GhPythonScript(path=path)  # -> out, m
# ---------- load_robot_base: Python ----------
#import ghpythonlib.treehelpers as th
import Rhino.Geometry as rg
import re

f = open(path+"wood.txt")
lines = f.readlines()
m = []
count = -1

for line in lines:
    count += 1
    line = line.replace("  ", " ")
    line = line.replace("  ", " ")
    while line[0] == ' ':
        line = line[1:]
    nums = re.split(" ", line)
#    print nums
    m.append(rg.Point3d(float(nums[0]), float(nums[1]), float(nums[2])))
f.close()
# ---------- end load_robot_base ----------

# ----
point = Point(load_robot_base.m)
polyline = PolyLine(Vertices=point, Closed=True)

# ---- group: ROBOT_BASE
load_robot_base_2 = GhPythonScript(path=path)  # -> out, m
# ---------- load_robot_base_2: Python ----------
f = open(path+"result.txt")
m = []
for _ in range(16):
    m.append(f.readline())
f.close()
# ---------- end load_robot_base_2 ----------

# ---- group: ROBOT_BASE / m to mm
ghpython_script = GhPythonScript(x=load_robot_base_2.m)  # -> out, a; inputs x: list
# ---------- ghpython_script: Python ----------
a = []
for i in range(len(x)):
    if i == 3 or i == 7 or i == 11:
        a.append(1000.0*x[i])
    else:
        a.append(x[i])
# ---------- end ghpython_script ----------

# ---- group: ROBOT_BASE (continued)
construct_matrix = ConstructMatrix(Rows="4", Columns="4", Values=ghpython_script.a)
pose2plane = Pose2plane(matrix=construct_matrix)

# ----
plane = Plane(pose2plane)

# ---- group: MARKERS
load_markers = GhPythonScript(path=path, num="3")  # -> out, m; inputs num: Int32
# ---------- load_markers: Python ----------
import ghpythonlib.treehelpers as t

m = []
for i in range(num):
    m.append([])
    f = open(path+("w2k_%d.txt"%i))
    for _ in range(16):
        m[i].append(f.readline())
    f.close()
m = t.list_to_tree(m)
# ---------- end load_markers ----------

# ---- group: MARKERS / m to MM
ghpython_script_2 = GhPythonScript(x=load_markers.m)  # -> out, a; inputs x: list; same code as ghpython_script

# ---- group: MARKERS (continued)
construct_matrix_2 = ConstructMatrix(Rows="4", Columns="4", Values=ghpython_script_2.a)  # -> flatten(Matrix)
pose2plane_2 = Pose2plane(matrix=construct_matrix_2)  # -> flatten(plane)

# ----
plane_2 = Plane(pose2plane_2)

panel = Panel("""MARKER_00
MARKER_01
MARKER_02""")
text_tag_3d = TextTag3D(Location=plane, Text="ROBOT_BASE", Size=30, Justification=5)
construct_domain = ConstructDomain(DomainStart=expr("-0.5*x", "200"), DomainEnd=expr("0.5*x", "200"))
text_tag_3d_2 = TextTag3D(Location=plane_2, Text=panel, Size=30, Justification=5)
rectangle = Rectangle(Plane=plane_2, XSize=construct_domain, YSize=construct_domain, Radius=0)  # -> Rectangle, Length

# ==== cluster Pose2plane
matrix = ClusterInput()
deconstruct_matrix = DeconstructMatrix(Matrix=matrix)  # -> Rows, Columns, Values
panel = Panel("""3
7
11""")
panel_2 = Panel("""0
4
8""")
panel_3 = Panel("""1
5
9""")
list_item = ListItem(List=deconstruct_matrix.Values, Index=panel, Wrap=True)
list_item_2 = ListItem(List=deconstruct_matrix.Values, Index=panel_2, Wrap=True)
list_item_3 = ListItem(List=deconstruct_matrix.Values, Index=panel_3, Wrap=True)
list_item_4 = ListItem(List=list_item, Index=0, Wrap=True)  # -> Item, Item1, Item2
list_item_5 = ListItem(List=list_item_2, Index=0, Wrap=True)  # -> Item, Item1, Item2
list_item_6 = ListItem(List=list_item_3, Index=0, Wrap=True)  # -> Item, Item1, Item2
construct_point = ConstructPoint(XCoordinate=list_item_4.Item, YCoordinate=list_item_4.Item1, ZCoordinate=list_item_4.Item2)
vector_xyz = VectorXYZ(XComponent=list_item_5.Item, YComponent=list_item_5.Item1, ZComponent=list_item_5.Item2)  # -> Vector, Length
vector_xyz_2 = VectorXYZ(XComponent=list_item_6.Item, YComponent=list_item_6.Item1, ZComponent=list_item_6.Item2)  # -> Vector, Length
construct_plane = ConstructPlane(Origin=construct_point, XAxis=vector_xyz.Vector, YAxis=vector_xyz_2.Vector)
plane = ClusterOutput(construct_plane)
